# Grasshopper definition Spikey_setup.gh (Grasshopper 1.0.7)
# plug-ins: Hops

hops = Hops(
    Width=Slider(12, range=1..20),
    Length=Slider(15, range=0..100),
    FloorHeight=Slider(4, range=0..10),
    CountOfFloors=Slider(30, range=0..100),
    NumberOfWindows=Slider(5, range=0..10),
    Colour=0.7,
    CacheResultsInMemory=True,
    CacheSolveResults=True,
    RemoteDefinitionLocation="C:\Users\saeed\Downloads\Telegram Desktop\RectangularBuildingEdited20240304.gh",
    RemoteSolveVersion=(0, 1, 0),
    ShowInput_Enabled=False,
    ShowInput_Path=False,
    SynchronousSolve=True)
