# Grasshopper definition Eco-RTKPi3v4.gh (Grasshopper 1.0.7)

colours = ValueList({"Concrete": 11, "Wood": 57, "Steel": 1}, selected="Wood")

# ----
# Rectangle Side
# rectangle side
# floor height
# total floors including the roof
# number of windows
# colour
number_slider = Slider(15, range=0..100)
# Starting Notes
# 
# Just choose a point in rhino file to place your building
# then use the controls to change any parameter you want
# enjoy
# Parametric Controls
number_slider_2 = Slider(10, range=0..100)
# window height
colours_2 = GetNumber(colours, AtLeast=1, AtMost=1, Maximum=1.797693135e+308, Minimum=-1.797693135e+308, TreeAccess=False)
width = GetNumber(number_slider_2, AtLeast=1, AtMost=1, Maximum=1.797693135e+308, Minimum=-1.797693135e+308, TreeAccess=False)
number_of_windows = GetNumber(Slider(4, range=0..20), AtLeast=1, AtMost=1, Maximum=1.797693135e+308, Minimum=-1.797693135e+308, TreeAccess=False)
count_of_floors = GetNumber(Slider(13, range=0..100), AtLeast=1, AtMost=1, Maximum=1.797693135e+308, Minimum=-1.797693135e+308, TreeAccess=False)
length = GetNumber(number_slider, AtLeast=1, AtMost=1, Maximum=1.797693135e+308, Minimum=-1.797693135e+308, TreeAccess=False)
floor_height = GetNumber(Slider(3, range=0..12), AtLeast=1, AtMost=1, Maximum=1.797693135e+308, Minimum=-1.797693135e+308, TreeAccess=False)

# ----
# window distance from floor
panel = Panel("1.2")
# Starter Point
point = Point(Point(0, 0, 0))
# floor Thickness
panel_2 = Panel("0.2")
# main wall thinkness
panel_3 = Panel("0.4")
# roof ridge
panel_4 = Panel("0.7")
# roof ridge thickness
panel_5 = Panel("0.1")
division = Division(A=length, B=2)
division_2 = Division(A=width, B=2)
center_box = CenterBox(Base=point, X=division_2, Y=division, Z="0")
unit_z = UnitZ(Factor=floor_height)
deconstruct_brep = DeconstructBrep(Brep=center_box)  # -> Faces, Edges, Vertices
join_curves = JoinCurves(Curves=deconstruct_brep.Edges, Preserve=False)
curve = Curve(join_curves)
curve_2 = Curve(curve)
explode = Explode(Curve=curve_2, Recursive=True)  # -> Segments, Vertices
area = Area(Geometry=curve_2)  # -> Area, Centroid
linear_array = LinearArray(Geometry=curve_2, Direction=unit_z, Count=count_of_floors)  # -> Geometry, Transform
line_sdl = LineSDL(Start=area.Centroid, Direction=unit_z, Length=1)
# area of each floor
panel_6 = Panel(area.Area)
area_2 = Area(Geometry=linear_array.Geometry)  # -> Area, Centroid
list_item = ListItem(List=explode.Segments, Index=0, Wrap=True)  # -> Item, Item1, Item2, Item3
list_item_2 = ListItem(List=explode.Vertices, Index=0, Wrap=True)  # -> Item, Item1, Item2, Item3
line = Line(list_item.Item)
line_2 = Line(list_item.Item1)
line_3 = Line(list_item.Item2)
line_4 = Line(list_item.Item3)
point_2 = Point(area_2.Centroid)
# total area (including the roof)
multiplication = Multiplication(A=panel_6, B=count_of_floors)
panel_7 = Panel(multiplication)

# ----
# number of windows
# window width
multiplication_2 = Multiplication(A=number_of_windows, B=3)
divide_curve = DivideCurve(Curve=line, Count=multiplication_2, Kinks=False)  # -> Points, Tangents, Parameters
panel_8 = Panel("""0
1
1
0
1
1""")
dispatch = Dispatch(List=divide_curve.Points, DispatchPattern=panel_8)  # -> ListA, ListB
panel_9 = Panel("""1
0""")
point_3 = Point(dispatch.ListA)
list_item_3 = ListItem(List=point_3, Index=0, Wrap=True)  # -> Item, Item1
dispatch_2 = Dispatch(List=point_3, DispatchPattern=panel_9)  # -> ListA, ListB
distance = Distance(PointA=list_item_3.Item, PointB=list_item_3.Item1)
point_4 = Point(dispatch_2.ListA)
point_5 = Point(dispatch_2.ListB)
panel_10 = Panel(distance)
list_length = ListLength(List=point_3)
unit_z_2 = UnitZ(Factor=panel)
line_5 = Line(StartPoint=point_4, EndPoint=point_5)
division_3 = Division(A=list_length, B=2)
unit_z_3 = UnitZ(Factor="1.5")
move = Move(Geometry=line_5, Motion=unit_z_2)  # -> Geometry, Transform
panel_11 = Panel(division_3)
move_2 = Move(Geometry=move.Geometry, Motion=unit_z_3)  # -> Geometry, Transform
ruled_surface = RuledSurface(CurveA=move.Geometry, CurveB=move_2.Geometry)

# ----
# number of windows
# window width
multiplication_3 = Multiplication(A=number_of_windows, B=3)
divide_curve_2 = DivideCurve(Curve=line_4, Count=multiplication_3, Kinks=False)  # -> Points, Tangents, Parameters
panel_12 = Panel("""0
1
1
0
1
1""")
dispatch_3 = Dispatch(List=divide_curve_2.Points, DispatchPattern=panel_12)  # -> ListA, ListB
panel_13 = Panel("""1
0""")
point_6 = Point(dispatch_3.ListA)
list_item_4 = ListItem(List=point_6, Index=0, Wrap=True)  # -> Item, Item1
dispatch_4 = Dispatch(List=point_6, DispatchPattern=panel_13)  # -> ListA, ListB
distance_2 = Distance(PointA=list_item_4.Item, PointB=list_item_4.Item1)
point_7 = Point(dispatch_4.ListA)
point_8 = Point(dispatch_4.ListB)
panel_14 = Panel(distance_2)
list_length_2 = ListLength(List=point_6)
unit_z_4 = UnitZ(Factor=panel)
line_6 = Line(StartPoint=point_7, EndPoint=point_8)
division_4 = Division(A=list_length_2, B=2)
unit_z_5 = UnitZ(Factor="1.5")
move_3 = Move(Geometry=line_6, Motion=unit_z_4)  # -> Geometry, Transform
panel_15 = Panel(division_4)
move_4 = Move(Geometry=move_3.Geometry, Motion=unit_z_5)  # -> Geometry, Transform
ruled_surface_2 = RuledSurface(CurveA=move_3.Geometry, CurveB=move_4.Geometry)

# ----
# number of windows
# window width
multiplication_4 = Multiplication(A=number_of_windows, B=3)
divide_curve_3 = DivideCurve(Curve=line_3, Count=multiplication_4, Kinks=False)  # -> Points, Tangents, Parameters
panel_16 = Panel("""0
1
1
0
1
1""")
dispatch_5 = Dispatch(List=divide_curve_3.Points, DispatchPattern=panel_16)  # -> ListA, ListB
panel_17 = Panel("""1
0""")
point_9 = Point(dispatch_5.ListA)
list_item_5 = ListItem(List=point_9, Index=0, Wrap=True)  # -> Item, Item1
dispatch_6 = Dispatch(List=point_9, DispatchPattern=panel_17)  # -> ListA, ListB
distance_3 = Distance(PointA=list_item_5.Item, PointB=list_item_5.Item1)
point_10 = Point(dispatch_6.ListA)
point_11 = Point(dispatch_6.ListB)
panel_18 = Panel(distance_3)
list_length_3 = ListLength(List=point_9)
unit_z_6 = UnitZ(Factor=panel)
line_7 = Line(StartPoint=point_10, EndPoint=point_11)
division_5 = Division(A=list_length_3, B=2)
unit_z_7 = UnitZ(Factor="1.5")
move_5 = Move(Geometry=line_7, Motion=unit_z_6)  # -> Geometry, Transform
panel_19 = Panel(division_5)
move_6 = Move(Geometry=move_5.Geometry, Motion=unit_z_7)  # -> Geometry, Transform
ruled_surface_3 = RuledSurface(CurveA=move_5.Geometry, CurveB=move_6.Geometry)

# ----
# number of windows
# window width
multiplication_5 = Multiplication(A=number_of_windows, B=3)
divide_curve_4 = DivideCurve(Curve=line_2, Count=multiplication_5, Kinks=False)  # -> Points, Tangents, Parameters
panel_20 = Panel("""0
1
1
0
1
1""")
dispatch_7 = Dispatch(List=divide_curve_4.Points, DispatchPattern=panel_20)  # -> ListA, ListB
panel_21 = Panel("""1
0""")
point_12 = Point(dispatch_7.ListA)
list_item_6 = ListItem(List=point_12, Index=0, Wrap=True)  # -> Item, Item1
dispatch_8 = Dispatch(List=point_12, DispatchPattern=panel_21)  # -> ListA, ListB
distance_4 = Distance(PointA=list_item_6.Item, PointB=list_item_6.Item1)
point_13 = Point(dispatch_8.ListA)
point_14 = Point(dispatch_8.ListB)
# Window Creation for each side
panel_22 = Panel(distance_4)
list_length_4 = ListLength(List=point_12)
unit_z_8 = UnitZ(Factor=panel)
line_8 = Line(StartPoint=point_13, EndPoint=point_14)
division_6 = Division(A=list_length_4, B=2)
unit_z_9 = UnitZ(Factor="1.5")
move_7 = Move(Geometry=line_8, Motion=unit_z_8)  # -> Geometry, Transform
panel_23 = Panel(division_6)
move_8 = Move(Geometry=move_7.Geometry, Motion=unit_z_9)  # -> Geometry, Transform
ruled_surface_4 = RuledSurface(CurveA=move_7.Geometry, CurveB=move_8.Geometry)

surface = Surface(ruled_surface_2)
surface_2 = Surface(ruled_surface_3)
surface_3 = Surface(ruled_surface_4)
surface_4 = Surface(ruled_surface)
geometry = Geometry(linear_array.Geometry)
geometry_2 = Geometry(linear_array.Geometry)
cluster = Cluster(geometry=surface_3)
cluster_2 = Cluster(geometry=surface)
cluster_3 = Cluster(geometry=surface_4)
cluster_4 = Cluster(geometry=surface_2)
list_item_7 = ListItem(List=geometry_2, Index=0, Wrap=True)  # -> Item1, Item
merge = Merge(Data1=surface_3, Data2=surface, Data3=surface_4, Data4=surface_2)
list_item_8 = ListItem(List=geometry, Index=0, Wrap=True)  # -> Item1, Item
curve_3 = Curve(list_item_7.Item1)
surface_5 = Surface(list_item_7.Item1)
subtraction = Subtraction(A=count_of_floors, B=1)
# window array
merge_2 = Merge(Data1=cluster, Data2=cluster_2, Data3=cluster_3, Data4=cluster_4)
# wall thickness
curve_4 = Curve(list_item_8.Item1)
curve_5 = Curve(list_item_8.Item)
offset_on_srf = OffsetOnSrf(Curve=curve_3, Distance=panel_5, Surface=surface_5)
surface_6 = Surface(geometry)
surface_7 = Surface(curve_5)
area_3 = Area(Geometry=curve_4)  # -> Area, Centroid
area_4 = Area(Geometry=curve_5)  # -> Area, Centroid
linear_array_2 = LinearArray(Geometry=merge_2, Direction=unit_z, Count=subtraction)  # -> Geometry, Transform
linear_array_3 = LinearArray(Geometry=merge, Direction=unit_z, Count=subtraction)  # -> Geometry, Transform
cull_index = CullIndex(List=geometry, Indices="0", Wrap=True)
cull_index_2 = CullIndex(List=surface_6, Indices="0", Wrap=True)
surface_8 = Surface(offset_on_srf)
distance_5 = Distance(PointA=area_3.Centroid, PointB=area_4.Centroid)
offset_on_srf_2 = OffsetOnSrf(Curve=curve_5, Distance=panel_3, Surface=surface_7)
unit_z_10 = UnitZ(Factor=panel_4)
solid_difference = SolidDifference(BrepsA=surface_5, BrepsB=surface_8)
offset_on_srf_3 = OffsetOnSrf(Curve=cull_index, Distance=panel_3, Surface=cull_index_2)
negative = Negative(Value=panel_2)
surface_9 = Surface(offset_on_srf_2)
surface_10 = Surface(offset_on_srf_3)
extrude = Extrude(Base=solid_difference, Direction=unit_z_10)
solid_difference_2 = SolidDifference(BrepsA=surface_7, BrepsB=surface_9)
unit_z_11 = UnitZ(Factor=negative)
flatten_tree = FlattenTree(Tree=linear_array_2.Geometry, Path="{0}")
surface_11 = Surface(solid_difference_2)
solid_union = SolidUnion(Breps=extrude)
unit_z_12 = UnitZ(Factor=distance_5)
extrude_2 = Extrude(Base=surface_10, Direction=unit_z_11)
deconstruct_brep_2 = DeconstructBrep(Brep=flatten_tree)  # -> Faces, Edges, Vertices
extrude_3 = Extrude(Base=surface_11, Direction=unit_z_12)
surface_12 = Surface(deconstruct_brep_2.Faces)
solid_union_2 = SolidUnion(Breps=extrude_3)

# ----
# creating Window Cavities
brep = Brep(solid_union_2)
brep_2 = Brep(linear_array_2.Geometry)
trim_solid = TrimSolid(Shape=brep, Cutters=flatten(brep_2))

list_item_9 = ListItem(
    List=surface_12,
    Index=[Slider(1, range=0..8), Slider(2, range=0..8), Slider(3, range=0..8), Slider(0, range=0..8)],
    Wrap=True)
geometry_3 = Geometry(list_item_9)
brep_3 = Brep(trim_solid)
brep_join = BrepJoin(Breps=[brep_3, geometry_3])  # -> Breps, Closed
geometry_4 = Geometry(extrude_2)
geometry_5 = Geometry(solid_union)
surface_13 = Surface(list_item_7.Item)
surface_14 = Surface(linear_array_3.Geometry)
merge_3 = Merge(Data1=geometry_4, Data2=surface_13)
gradient = Gradient(
    LowerLimit=Slider(0, range=0..100),
    UpperLimit=Slider(67, range=0..100),
    Parameter=colours_2,
    stops=[0.129: RGB(255, 255, 255), 0.141: RGB(7, 139, 93), 0.2: RGB(210, 0, 118), 0.249: RGB(243, 57, 0), 0.3: RGB(103, 0, 120), 0.5: RGB(1, 192, 229), 0.6: RGB(18, 178, 90), 0.7: RGB(79, 186, 8), 0.773: RGB(153, 242, 11), 0.8: RGB(220, 237, 32), 0.9: RGB(247, 159, 20), 1: RGB(243, 57, 0)])
geometry_6 = Geometry(geometry_5)
geometry_7 = Geometry(surface_14)
# Notes:
# Please view in Rendered Mode
# 
# Only selected objects are visible in grasshopper if you want everything to be visible please toggle the cilynder with half green color on top right corner of the grasshopper window.
# 
# White Panels Show some info about the design
# 
# Do not change the yellow panels
geometry_8 = Geometry(merge_3)
geometry_9 = Geometry(brep_join.Breps)
deconstruct_mesh = DeconstructMesh(Mesh=geometry_8)  # -> Vertices, Faces, Colours, Normals
deconstruct_mesh_2 = DeconstructMesh(Mesh=geometry_6)  # -> Vertices, Faces, Colours, Normals
deconstruct_mesh_3 = DeconstructMesh(Mesh=geometry_9)  # -> Vertices, Faces, Colours, Normals
deconstruct_mesh_4 = DeconstructMesh(Mesh=geometry_7)  # -> Vertices, Faces, Colours, Normals
construct_mesh = ConstructMesh(Vertices=deconstruct_mesh.Vertices, Faces=deconstruct_mesh.Faces, Colours=gradient)
construct_mesh_2 = ConstructMesh(Vertices=deconstruct_mesh_2.Vertices, Faces=deconstruct_mesh_2.Faces, Colours=gradient)
construct_mesh_3 = ConstructMesh(Vertices=deconstruct_mesh_3.Vertices, Faces=deconstruct_mesh_3.Faces, Colours=gradient)
construct_mesh_4 = ConstructMesh(Vertices=deconstruct_mesh_4.Vertices, Faces=deconstruct_mesh_4.Faces, Colours=ColourSwatch(SwatchColor=RGB(35, 76, 117)))
merge_4 = Merge(Data1=construct_mesh, Data2=construct_mesh_2, Data3=construct_mesh_3, Data4=construct_mesh_4)
context_bake = ContextBake(Geometry=merge_4)

# ==== cluster Cluster
geometry = ClusterInput()
area = Area(Geometry=geometry)  # -> Area, Centroid
evaluate_surface = EvaluateSurface(Surface=geometry, Point=area.Centroid)  # -> Point, Normal, UDirection, VDirection, Frame
reverse = Reverse(Vector=evaluate_surface.Normal)
surface = Surface(geometry)
vector_display = VectorDisplay(Anchor=area.Centroid, Vector=reverse)
amplitude = Amplitude(Vector=reverse, Amplitude="0.4")
move = Move(Geometry=geometry, Motion=amplitude)  # -> Geometry, Transform
graft_tree = GraftTree(Tree=surface, IncludeEmptyLists=True, IncludeNullItems=True)
graft_tree_2 = GraftTree(Tree=move.Geometry, IncludeEmptyLists=True, IncludeNullItems=True)
loft = Loft(
    Curves=[graft_tree_2, graft_tree],
    Options={Adjust=False, Closed=False, LoftEnds=0, LoftSimp=0, LoftType=0, Rebuild=10, Refit=0.01})
cap_holes = CapHoles(Brep=loft)
brep = ClusterOutput(cap_holes)
